# Grasshopper definition rhino_input.gh (Grasshopper 1.0.7)

number_slider = Slider(1, range=0..10)
encodedfile = GetString(AtLeast=1, AtMost=1, TreeAccess=False)

# ---- group: just to test
path = FilePath("C:\Users\david\IAAC\MaCAD\datamgmt\repos\bimsc24-datamgmt-session06\src\assets\rhino_input.3dm")

# ----
Y = GetNumber(number_slider, AtLeast=1, AtMost=1, Maximum=1.797693135e+308, Minimum=-1.797693135e+308, TreeAccess=False)
Z = GetNumber(number_slider, AtLeast=1, AtMost=1, Maximum=1.797693135e+308, Minimum=-1.797693135e+308, TreeAccess=False)
X = GetNumber(number_slider, AtLeast=1, AtMost=1, Maximum=1.797693135e+308, Minimum=-1.797693135e+308, TreeAccess=False)
# no points allowed in 3dm!
python = GhPythonScript(data=encodedfile, FP=path)  # -> out, geom, layerIndex, layers, instances, instLayInd
# ---------- python: Python ----------
import System
import Rhino

try:
    b64 = System.Convert.FromBase64String(data)
    _dmfile = Rhino.FileIO.File3dm.FromByteArray(b64)
except:
    _dmfile = Rhino.FileIO.File3dm.Read(FP)
    print _dmfile

objtable = _dmfile.Objects

geom = []
geomLayerIndexList = []
for obj in objtable:
    
    if not isinstance(obj.Geometry,Rhino.Geometry.InstanceReferenceGeometry):

        geom.append(obj.Geometry)
        geomLayerIndexList.append(obj.Attributes.LayerIndex)
        

geom_= geom
layerIndex_ = geomLayerIndexList

layers = []
for l in _dmfile.Layers:
    layers.append(l)
    
    




layers_ = layers



instances = []
instancesLayerIndexes = []

# 
for obj in objtable:
    
    if isinstance(obj.Geometry,Rhino.Geometry.InstanceReferenceGeometry):
        geom = obj.Geometry
        parentId = geom.ParentIdefId
        instanceDef = _dmfile.InstanceDefinitions.FindId(parentId)
        instanceDefIds = instanceDef.GetObjectIds()
        
        xf =  geom.Xform
        instancesLayerIndexes.append(obj.Attributes.LayerIndex)
        
        for idefId in instanceDefIds:
            instanceObj= _dmfile.Objects.FindId(idefId)
            newObjGeom = instanceObj.Geometry.Duplicate()
            newObjGeom.Transform(xf)
            instances.append(newObjGeom)
            
            
instances_ = instances
instLayInd_ = instancesLayerIndexes
# ---------- end python ----------
list = ValueList({"Mesh": 0, "Brep": 1, "SubD": 2, "Curve": 3}, selected="Brep")
type = GetString(list, AtLeast=1, AtMost=1, TreeAccess=False)

# ---- group: filter by type
python_2 = GhPythonScript(type=type, geo=python.geom)  # -> out, filter_geo, unfiltered; inputs type: Int32, geo: list of GeometryBase
# ---------- python_2: Python ----------
import Rhino.Geometry as rg
import rhinoscriptsyntax as rs

filter_geo= []
unfiltered = []
geo_types = ["Mesh", "Brep", "SubD", "NurbsCurve" ]

for g in geo:
    
    g = rs.coercegeometry(g)
    
    if type(g).__name__ == geo_types[_type]:

        filter_geo.append(g)
    else:
        unfiltered.append(g)
        
filter_geo_ = filter_geo
unfiltered_ = unfiltered
# ---------- end python_2 ----------

# ----
scale_nu = ScaleNU(Geometry=python_2.filter_geo, Plane=PlaneXY(0, 0, 0), ScaleX=X, ScaleY=Y, ScaleZ=Z)  # -> Geometry, Transform

# ---- group: convert breps to meshes
python_3 = GhPythonScript(geo=scale_nu.Geometry)  # -> out, converted; inputs geo: list of GeometryBase
# ---------- python_3: Python ----------
import Rhino.Geometry as rg

def convertBrepToMesh(brep):

    mp = rg.MeshingParameters.Coarse
    g = rg.Mesh.CreateFromBrep(brep, mp)
    newm = rg.Mesh()
    for meshes in g:
        newm.Append(meshes)
    return newm
    
converted = []

for g in geo:
    if type(g).__name__ == "Brep":
        try:
            mesh =convertBrepToMesh(g)
            
            converted.append(mesh)
        except:
            continue
    else:
        converted.append(g)

converted_ = converted
# ---------- end python_3 ----------

# ----
context_bake = ContextBake(ScaledGeo=python_3.converted)
